# Requirement set HEV_PowSupervisory (R2020b)
HEV_PowSupervisory Algorithm Requirement Specification

Spec Version : 1.0

## 1 [#1] Algorithm For HEV System Power Management (Container)
The following requirement describes the design and implementation details for System Power Management of HEV.

## 2 [#2] System Framework (Informational)
The framework consists of ON/OFF states of the engine, motor, and generator and respective transition between different states based on various conditions

## 3 [#10] Inputs (Container)
Specification of Inputs used by the Algorithm

### 3.1 [#12] Speed
This signal is the vehicle speed, expressed in km/h.

### 3.2 [#13] Brake
This input specifies the Brake signal.

### 3.3 [#14] Charge
This input signal the battery Charge percentage value. Range is 0-100%.

### 3.4 [#15] Engine Speed
This signal specifies the engine speed used by the algorithm

## 4 [#11] Outputs (Container)
Specification of Algorithm Outputs

### 4.1 [#16] Motor Enable
Electric Motor Enable Signal

### 4.2 [#17] Generator Enable
Status Generator for charging information

### 4.3 [#18] Engine Enable
Status of ICE Engine - Enabled or Disabled

## 5 [#19] Constant
Specification of Constants used by the Algorithm

### 5.1 [#20] Engine On Speed (Informational)
Engine ON Speed or EngOnRPM specifies the Engine RPM beyond which the ICE get enabled

### 5.2 [#21] Engine Off RPM (Informational)
Engine OFF Speed or EngOffRPM specifies the Engine RPM below which the ICE gets disabled

## 6 [#4] Operation Modes (Container)
The algorithm should comprise of 4 modes
- Low Speeds/Start
- Acceleration
- Cruising
- Braking
The following switching mechanism is applied between the states :-
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
### 6.1 [#5] Low speeds/Start
The electric motor provides all the torque for initial acceleration

### 6.2 [#6] Acceleration
As the vehicle reaches a predefined speed, the engine kicks in to supply power along with the motor.

### 6.3 [#7] Cruising
If the car maintains constant speed, the motor is switched off and the generator is switched on. A portion of the engine’s power is used by the generator to recharge the battery.

### 6.4 [#9] Braking
If brakes are applied, the engine and the generator are switched off. The motor is made to behave like a generator to recharge the battery.