% Requirement links of Mode_Logic_Ex.slx (R2020b)

model implements HEV_PowSupervisory.slreqx#1: Algorithm For HEV System Power Management
model implements HEV_PowSupervisory.slreqx#2: System Framework
block :1 implements HEV_PowSupervisory.slreqx#4: Operation Modes
block :1 implements HEV_PowSupervisory.slreqx#19: Constant
block :1:2 implements HEV_PowSupervisory.slreqx#7: Cruising
block :1:3 implements HEV_PowSupervisory.slreqx#6: Acceleration
block :1:4 implements HEV_PowSupervisory.slreqx#5: Low speeds/Start
block :1:5 implements HEV_PowSupervisory.slreqx#9: Braking
block :2 implements HEV_PowSupervisory.slreqx#12: Speed
block :3 implements HEV_PowSupervisory.slreqx#13: Brake
block :4 implements HEV_PowSupervisory.slreqx#14: Charge
block :5 implements HEV_PowSupervisory.slreqx#15: Engine Speed
block :6 implements HEV_PowSupervisory.slreqx#16: Motor Enable
block :7 implements HEV_PowSupervisory.slreqx#17: Generator Enable
block :8 implements HEV_PowSupervisory.slreqx#18: Engine Enable