% Requirement links of Mode_Logic_TC.mldatx (R2020b)

item 1 verifies HEV_PowSupervisory.slreqx#4: Operation Modes
item 1 verifies HEV_PowSupervisory.slreqx#5: Low speeds/Start
item 1 verifies HEV_PowSupervisory.slreqx#6: Acceleration
item 1 verifies HEV_PowSupervisory.slreqx#9: Braking
item 2 verifies HEV_PowSupervisory.slreqx#1: Algorithm For HEV System Power Management
item 3 verifies HEV_PowSupervisory.slreqx#4: Operation Modes
item 4 verifies HEV_PowSupervisory.slreqx#1: Algorithm For HEV System Power Management