test file "Mode_Logic_TC"
  coverage: Decision, Condition

suite "Mode_Logic_MIL"

  case "Mode_Logic_TestSequence" [simulation]
    model Mode_Logic_Ex, harness Mode_Logic_Ex_Harness1, mode Normal
    assessment "Regenerative Behaviour": At any point of time, if Brake >= FivePercent becomes true then, with no delay, MotorEnable == True must be true
    assessment "Low Charge Engine Active": At any point of time, if GeneratorEnable == True & EngineEnable == True becomes true then, with no delay, MotorEnable == False must be true
      Brake: signal Mode_Logic_Ex_Harness1/Input Conversion Subsystem, port 2
      GeneratorEnable: signal Mode_Logic_Ex_Harness1/Mode_Logic_Ex, port 2
      False: expression 0
      EngineEnable: signal Mode_Logic_Ex_Harness1/Mode_Logic_Ex, port 3
      MotorEnable: signal Mode_Logic_Ex_Harness1/Mode_Logic_Ex, port 1
      True: expression 1
      FivePercent: expression 0.05

  case "Mode_Logic_ExcelImport" [baseline]
    model Mode_Logic_Ex, harness Mode_Logic_Ex_Harness2, mode Normal
    input "ModelLogic_TestScenario.xlsx", sheet InputScenario_And_Parameters, mapped to Speed -> speed, Brake -> brake, Charge -> charge, EngSpeed -> engine_speed (active)
    baseline "baseline_output"
      Mot_Enable
      Gen_Enable
      ICE_Enable

  case "Mode_Logic_TestSequence1" [simulation]
    description: Just Added Extra Test Case to Trigger new build
    model Mode_Logic_Ex, harness Mode_Logic_Ex_Harness1, mode Normal
    assessment "Regenerative Behaviour": At any point of time, if Brake >= FivePercent becomes true then, with no delay, MotorEnable == True must be true
    assessment "Low Charge Engine Active": At any point of time, if GeneratorEnable == True & EngineEnable == True becomes true then, with no delay, MotorEnable == False must be true
      Brake: signal Mode_Logic_Ex_Harness1/Input Conversion Subsystem, port 2
      GeneratorEnable: signal Mode_Logic_Ex_Harness1/Mode_Logic_Ex, port 2
      False: expression 0
      EngineEnable: signal Mode_Logic_Ex_Harness1/Mode_Logic_Ex, port 3
      MotorEnable: signal Mode_Logic_Ex_Harness1/Mode_Logic_Ex, port 1
      True: expression 1
      FivePercent: expression 0.05